# Grasshopper definition test.gh (Grasshopper 0.9.76)
# plug-ins: MeshEdit Components, Circulation

geo = Geometry(<curve referenced from the Rhino model>)
settings = NodeSettings(Geometry=geo)
dwell = Point(Point(5.143834887, 7.513801428, 0))
pt = Point(Point(2, 14, 0))
pt_2 = Point(Point(12, 2, 0))
geo_2 = Geometry(<curve referenced from the Rhino model>)
geo_3 = Geometry(<curve referenced from the Rhino model>)
node = Node(Position=dwell, Name="dwell", Floor="floor", Settings=settings)
node_2 = Node(Position=pt, Name="end", Floor="floor")
node_3 = Node(Position=pt_2, Name="start", Floor="floor")
floor = Floor(Boundary=geo_3, Name="floor")
barrier = Barrier(Boundary=geo_2, Floor="floor")
settings_2 = AgentSettings(PathNodes="dwell")
agent = Agent(Name="agent", Origin="start", Destination="end", Settings=settings_2)
env = Environment(Entities=[floor, barrier, node_3, node_2, node, agent], Resolution=Slider(0.5, range=0..1), Run=Toggle(True))

apaths = AgentPaths(Environment=env, AgentName="agent")  # -> Mesh, Indexes, Log
explode = MeshExplode(Mesh=apaths.Mesh, Interpolate=False)
facen = FaceNormals(Mesh=explode)  # -> flatten(Centers), Normals
item = ListItem(List=facen.Centers, Index=apaths.Indexes, Wrap=True)
pline = PolyLine(Vertices=item, Closed=False)

dmap = DensityMap(Environment=env, FloorName="floor")  # -> Mesh, Values
explode_2 = MeshExplode(Mesh=dmap.Mesh, Interpolate=False)
gradient = Gradient(LowerLimit=0, UpperLimit=1, Parameter=dmap.Values, stops=[0: RGB(0, 128, 0), 0.5: RGB(255, 255, 0), 1: RGB(255, 0, 0)])
preview = CustomPreview(Geometry=explode_2, Shader=gradient)

bmap = BarrierMap(Environment=env, FloorName="floor")  # -> Mesh, Values
explode_3 = MeshExplode(Mesh=bmap.Mesh, Interpolate=False)
gradient_2 = Gradient(LowerLimit=0, UpperLimit=1, Parameter=bmap.Values, stops=[0: RGB(0, 128, 0), 0.5: RGB(255, 255, 0), 1: RGB(255, 0, 0)])
preview_2 = CustomPreview(Geometry=explode_3, Shader=gradient_2)
